# Grasshopper definition cabidas_FINAL_V2_Fixed.gh (Grasshopper 1.0.8)
# plug-ins: opennest_2 Info, Hops, LunchBox

digit_scroller = DigitScroller(Scroller_Digits=12, Scroller_Radix=11, Scroller_Value=-361)

# ---- group: NORMA
sup_bruta = Curve(<curve referenced from the Rhino model>)
area = Area(Geometry=sup_bruta)  # -> Area, Centroid
lote = Curve(<curve referenced from the Rhino model>)
area_2 = Area(Geometry=lote)  # -> Area, Centroid
antejardín_m = Slider(5, range=0..10)
superficie_bruta_m_2 = Panel(area.Area)
superficie_útil_m_2 = Panel(area_2.Area)
resolución_región_útil = Slider(37, range=0..100)
ángulo_rasante = Slider(6, range=6..8, expression="x*10")
altura_máxima = Slider(100, range=4..100)
coef_constructibilidad = Slider(3.6, range=0..10)
coef_ocupación = Slider(4, range=0..10, expression="x/10")
densidad_hab_ha = Slider(900, range=0..10000)
rasante_visible = RasanteVisible(crv=sup_bruta, num=ángulo_rasante)
division = Division(A=altura_máxima, B=2.8)
_10000 = Number(10000)
_4 = Number(4)
multiplication = Multiplication(A=superficie_útil_m_2, B=coef_constructibilidad)
division_2 = Division(A=area.Area, B=_10000)
division_3 = Division(A=area_2.Area, B=_10000)
multiplication_2 = Multiplication(A=superficie_útil_m_2, B=coef_ocupación)
division_4 = Division(A=densidad_hab_ha, B=_4)
neg = Negative(Value=antejardín_m)
round = Round(Number=division)  # -> Nearest, Floor, Ceiling
superficie_útil_ha = Panel(division_3)
área_habitable_m_2 = Panel(multiplication)
densidad_viv_ha = Panel(division_4)
superficie_bruta_ha = Panel(division_2)
área_de_ocupación_m_2 = Panel(multiplication_2)
offset = OffsetCurve(Curve=lote, Distance=neg, Corners=1)
región_útil_norma = RegiónÚtilNorma(
    resolución_región_útil=resolución_región_útil,
    lote_antejardín=offset,
    altura_máxima_bloque=altura_máxima,
    superficie_bruta=sup_bruta,
    ángulo_rasante=ángulo_rasante,
    altura_máxima_norma=division)  # -> isocurvas, región_útil_2, rasante_altura
brep = Brep(región_útil_norma.región_útil_2)
multiplication_3 = Multiplication(A=superficie_bruta_ha, B=densidad_viv_ha)
multiplication_4 = Multiplication(A=superficie_bruta_ha, B=densidad_hab_ha)
carga_máxima_viv_ha = Panel(multiplication_3)
carga_máxima_hab_ha = Panel(multiplication_4)

# ----
int = Integer(Slider(0.833, range=0..1))
int_2 = Integer(Slider(0.145, range=0..1))
hops_test = Hops(
    CacheResultsInMemory=True,
    CacheSolveResults=True,
    RemoteDefinitionLocation="http://localhost:3000/add",
    RemoteSolveVersion=(0, 1, 0),
    ShowInput_Enabled=True,
    ShowInput_Path=True,
    SynchronousSolve=False)

# ---- group: OPEN NEST
toggle = BooleanToggle(True)
panel = Panel("1")
panel_2 = Panel("0")

# ----
colour = ColourPicker(PickedColour=RGBA(0, 255, 4, 0))
colour_2 = ColourPicker(PickedColour=RGBA(255, 0, 0, 0))

# ---- group: DEFINIR ALTURAS DE BLOQUES
área_de_ocupación = Surface(offset)

# ----
crv = Curve(área_de_ocupación)

sheets = Sheets(Polylines=crv, Gap=Slider(10, range=10..100), Rows=Slider(1, range=1..20), Copies=Slider(1, range=1..1000))  # -> Sheets, Polylines

# ---- group: OPEN NEST
number = Number(21.6)
_12 = Number(12)
_35 = Number(35)
iterations = Slider(100, range=1..100)
toggle_2 = BooleanToggle(True)

# ---- group: OUTPUT DE CÁLCULOS + PARÁMETROS DE DISEÑO
espaciado_m = Slider(9, range=0..100)
rotación_grados = Slider(160, range=0..360)
tipo = Slider(0, range=0..2)
semilla = Slider(9, range=0..100)
panel_3 = Panel("""TIPOLOGÍA 1
TORRE 
20x20 m""")
n_de_torres = Slider(6, range=0..50)
altura_torre_n_de_pisos_max = Slider(15, range=1..20)
n_pisos_máximo = Panel(round.Floor)
panel_4 = Panel("""TIPOLOGÍA 2
BARRA
12x35 m""")
n_de_barras = Slider(5, range=0..50)
panel_5 = Panel("DISTRIBUCIÓN BLOQUES")
altura_barra_n_de_pisos_max = Slider(6, range=1..20)
área_construible_m_2 = Panel(área_habitable_m_2)
round_2 = Round(Number=multiplication_3)  # -> Nearest, Floor, Ceiling
carga_máxima_viv_ha_2 = Panel(round_2.Floor)

# ---- group: OPEN NEST
rotaciones = Number(rotación_grados)
tipo_de_posicionamiento = Number(tipo)
espaciado = Number(espaciado_m)
seed = Number(semilla)
nest_options = Options(
    Rotations=rotaciones,
    Wiggle=Slider(0, range=0..5.01),
    PlacementType=tipo_de_posicionamiento,
    Spacing=espaciado,
    Seed=seed,
    SimplifyTolerance=Slider(0.01, range=0.01..10),
    Mutation=Slider(10, range=1..100),
    Population=Slider(5, range=1..100000),
    Time=Slider(0, range=0..120),
    SheetFont="MecSoft_Font-1 -10")

definir_tipoligías = DefinirTipoligías(x_torre=number, y_torre=number, n_torres=n_de_torres, x_barra=_12, y_barra=_35, n_barras=n_de_barras)  # -> área_torre, crv_2, área_barra
project = Project(BaseEdificioS=definir_tipoligías.crv_2)  # -> Polyline, Plane

# ----
crv_2 = Curve(definir_tipoligías.crv_2)
geometry = Geometry(Outlines=project.Polyline, Simplify=panel_2, Hull=toggle, Copies=panel)  # -> Geometry, Borders
opennest2 = OpenNest2(Sheets=sheets.Sheets, Geometry=geometry.Geometry, Options=nest_options, Iterations=iterations, Run=toggle_2)  # -> Sheets, Borders, AllGeometry, Transforms, SheetId, SheetTxt, Attributes

# ---- group: OPEN NEST (continued)
object = ModelObject(Geometry=opennest2.AllGeometry)  # -> Object, Geometry, Name, Layer, Visibility, Display, Drafting, Render

# ---- group: DEFINIR ALTURAS DE BLOQUES (continued)
cache = ContentCache(Content=object.Object, Action=Button())  # -> flatten(Content), Result
filtro_bloques = FiltroBloques(área_útil=área_de_ocupación, open_nest=cache.Content)
base_de_edificios = Curve(filtro_bloques)
srf = Surface(base_de_edificios)
definir_resultados = DefinirResultados(área_barra=definir_tipoligías.área_barra, srf_dentro_del_lote=srf)  # -> bases_barras, bases_torres, área_ocupada, n_barras, n_torres, n_bloques
barra = CullIndex(List=srf, Indices=definir_resultados.bases_barras, Wrap=True)
torre = CullIndex(List=srf, Indices=definir_resultados.bases_torres, Wrap=True)
región_barra = RegiónÚtilNorma(
    resolución_región_útil=resolución_región_útil,
    lote_antejardín=offset,
    altura_máxima_bloque=altura_barra_n_de_pisos_max,
    superficie_bruta=sup_bruta,
    ángulo_rasante=ángulo_rasante,
    altura_máxima_norma=altura_barra_n_de_pisos_max)  # -> isocurvas, región_útil_2, rasante_altura
región_torre = RegiónÚtilNorma(
    resolución_región_útil=resolución_región_útil,
    lote_antejardín=offset,
    altura_máxima_bloque=altura_torre_n_de_pisos_max,
    superficie_bruta=sup_bruta,
    ángulo_rasante=ángulo_rasante,
    altura_máxima_norma=altura_torre_n_de_pisos_max)  # -> isocurvas, región_útil_2, rasante_altura
densidad_área_ocupada = DensidadÁreaOcupada(
    base_torres=torre,
    región_útil_torres=región_torre.región_útil_2,
    base_barras=barra,
    región_útil_barras=región_barra.región_útil_2)  # -> torres, barras, área_construida, densidad_total
brep_2 = Brep(densidad_área_ocupada.barras)
brep_3 = Brep(densidad_área_ocupada.torres)
brep_4 = Brep(región_barra.región_útil_2)
brep_5 = Brep(región_torre.región_útil_2)

# ----
wires = BrepWireframe(Brep=brep_4, Density=-1)
wires_2 = BrepWireframe(Brep=brep_5, Density=-1)

# ---- group: OUTPUT DE CÁLCULOS + PARÁMETROS DE DISEÑO (continued)
round_3 = Round(Number=densidad_área_ocupada.densidad_total)  # -> Nearest, Floor, Ceiling
brep_6 = Brep(flatten([brep_2, brep_3]))
área_construida_m_2 = Panel(densidad_área_ocupada.área_construida)
área_ocupada_m_2 = Panel(definir_resultados.área_ocupada)
densidad_total_viv_ha = Panel(round_3.Floor)
n_barras_en_el_lote = Panel(definir_resultados.n_barras)
n_torres_en_el_lote = Panel(definir_resultados.n_torres)
n_bloques_en_el_lote = Panel(definir_resultados.n_bloques)

# ----
preview = CustomPreview(Geometry=wires, Material=colour)
preview_2 = CustomPreview(Geometry=wires_2, Material=colour_2)

# ---- group: DISPLAY DE BLOQUES
Z = UnitZ(Factor=1)
wires_3 = BrepWireframe(Brep=brep_6, Density=-1)
brep_7 = Brep(brep_2)
bruta = Bruta(S=sup_bruta, C=lote)
sup_util = Surface(offset)
antejardín = Bruta(S=lote, C=offset)
move = Move(Geometry=bruta, Motion=Z)  # -> Geometry, Transform
move_2 = Move(Geometry=sup_util, Motion=Z)  # -> Geometry, Transform
move_3 = Move(Geometry=antejardín, Motion=Z)  # -> Geometry, Transform
move_4 = Move(Geometry=wires_3, Motion=Z)  # -> Geometry, Transform
move_5 = Move(Geometry=brep_3, Motion=Z)  # -> Geometry, Transform
move_6 = Move(Geometry=brep_7, Motion=Z)  # -> Geometry, Transform
Z_2 = UnitZ(Factor=-1)
extr = Extrude(Base=move.Geometry, Direction=Z_2)
extr_2 = Extrude(Base=move_2.Geometry, Direction=Z_2)
extr_3 = Extrude(Base=move_3.Geometry, Direction=Z_2)
brep_8 = Brep(extr_3)
brep_9 = Brep(extr_2)
press_for_bake = Button()
bake = ObjectBake(
    BakeToggle=press_for_bake,
    GeometryObjects=move_6.Geometry,
    Layer="barras_vp",
    ObjectName="GH_Obj",
    ObjectColor=RGB(255, 255, 255),
    LayerColor=RGB(255, 255, 255))
bake_2 = ObjectBake(
    BakeToggle=press_for_bake,
    GeometryObjects=move_5.Geometry,
    Layer="torres_vp",
    ObjectName="GH_Obj",
    ObjectColor=RGB(255, 255, 255),
    LayerColor=RGB(255, 255, 255))
bake_3 = ObjectBake(
    BakeToggle=press_for_bake,
    GeometryObjects=move_4.Geometry,
    Layer="bordes_vp",
    ObjectName="GH_Obj",
    ObjectColor=RGB(255, 255, 255),
    LayerColor=RGB(255, 255, 255))
bake_4 = ObjectBake(
    BakeToggle=press_for_bake,
    GeometryObjects=brep_8,
    Layer="antejardín_vp",
    ObjectName="GH_Obj",
    ObjectColor=RGB(255, 255, 255),
    LayerColor=RGB(255, 255, 255))
bake_5 = ObjectBake(
    BakeToggle=press_for_bake,
    GeometryObjects=brep_9,
    Layer="Lote_vp",
    ObjectName="GH_Obj",
    ObjectColor=RGB(255, 255, 255),
    LayerColor=RGB(255, 255, 255))
colour_3 = ColourPicker(PickedColour=RGB(122, 122, 122))
preview_3 = CustomPreview(Geometry=move_6.Geometry, Material=colour_3)
colour_4 = ColourPicker(PickedColour=RGB(209, 209, 209))
preview_4 = CustomPreview(Geometry=[move_5.Geometry, move_4.Geometry], Material=colour_4)
colour_5 = ColourPicker(PickedColour=RGB(140, 212, 104))
preview_5 = CustomPreview(Geometry=brep_8, Material=colour_5)
colour_6 = ColourPicker(PickedColour=RGB(207, 186, 163))
preview_6 = CustomPreview(Geometry=brep_9, Material=colour_6)
colour_7 = ColourPicker(PickedColour=RGB(119, 138, 143))
colour_8 = ColourPicker(PickedColour=RGB(255, 255, 255))
preview_7 = CustomPreview(Geometry=move_4.Geometry, Material=colour_8)

# ----
cap = CapHoles(Brep=extr)

# ---- group: DISPLAY DE BLOQUES (continued)
brep_10 = Brep(cap)
bake_6 = ObjectBake(
    BakeToggle=press_for_bake,
    GeometryObjects=brep_10,
    Layer="Sup Bruta_vp",
    ObjectName="GH_Obj",
    ObjectColor=RGB(255, 255, 255),
    LayerColor=RGB(255, 255, 255))
preview_8 = CustomPreview(Geometry=brep_10, Material=colour_7)

# ----
preview_9 = CustomPreview(Geometry=sup_util, Material=colour_6)
preview_10 = CustomPreview(Geometry=antejardín, Material=colour_5)
preview_11 = CustomPreview(Geometry=bruta, Material=colour_7)

# ==== cluster RasanteVisible
crv = ClusterInput()
num = ClusterInput()
crv_2 = Curve(crv)
num_2 = Number(num)
disc = Discontinuity(Curve=crv_2, Level=1)  # -> Points, Parameters
_5 = Number(10)
neg = Negative(Value=num_2)
shift = ShiftList(List=disc.Points, Shift=-1, Wrap=True)
area = Area(Geometry=crv_2)  # -> Area, Centroid
shift_2 = ShiftList(List=disc.Points, Shift=1, Wrap=True)
number_slider = Slider(4, range=0..10)
number_slider_2 = Slider(6, range=0..10)
vec2pt = Vector2Pt(PointA=disc.Points, PointB=shift, Unitize=False)  # -> Vector, Length
sin = Sine(Value=degrees(num_2))
unit = UnitVector(Vector=vec2pt.Vector)
vec2pt_2 = Vector2Pt(PointA=disc.Points, PointB=shift_2, Unitize=False)  # -> Vector, Length
vec2pt_3 = Vector2Pt(PointA=area.Centroid, PointB=disc.Points, Unitize=False)  # -> Vector, Length
division = Division(A=_5, B=sin)
unit_2 = UnitVector(Vector=vec2pt_2.Vector)
addition = Addition(A=unit_2, B=unit)
dprod = DotProduct(VectorA=vec2pt_3.Vector, VectorB=addition, Unitize=True)
round = Round(Number=dprod)  # -> Nearest, Floor, Ceiling
neg_2 = Negative(Value=round.Nearest)
multiplication = Multiplication(A=addition, B=neg_2)
line = LineSDL(Start=disc.Points, Direction=multiplication, Length=division)
rotate = Rotate(Geometry=line, Angle=degrees(90), Plane=disc.Points)  # -> Geometry, Transform
rot3d = Rotate3D(Geometry=line, Angle=degrees(neg), Center=disc.Points, Axis=rotate.Geometry)  # -> Geometry, Transform
loft = Loft(Curves=rot3d.Geometry, Options={Adjust=False, Closed=True, LoftEnds=0, LoftSimp=0, LoftType=3, Rebuild=10, Refit=0.01})

# ==== cluster RegiónÚtilNorma
resolución_región_útil = ClusterInput()
lote_antejardín = ClusterInput()
altura_máxima_bloque = ClusterInput()
superficie_bruta = ClusterInput()
ángulo_rasante = ClusterInput()
altura_máxima_norma = ClusterInput()
multiplication = Multiplication(A=altura_máxima_norma, B=2.8)
multiplication_2 = Multiplication(A=altura_máxima_bloque, B=2.8)
addition = Addition(A=multiplication, B=0.1)
altura_máx_rasante = AlturaMáxRasante(crv=superficie_bruta, num=ángulo_rasante, A=addition)  # -> curvas_loft_2, loft_3, srf_2
crv = Curve(lote_antejardín)
sdivide = DivideSurface(Surface=crv, UCount=resolución_región_útil, VCount=resolución_región_útil)  # -> flatten(Points), Normals, Parameters
clean = CleanTree(RemoveNulls=True, RemoveInvalid=True, RemoveEmpty=False, Tree=sdivide.Points)
srf = Surface(altura_máx_rasante.srf_2)
join = BrepJoin(Breps=srf)  # -> simplify(flatten(Breps)), Closed
Z = UnitZ(Factor=1)
brep = Brep(join.Breps)
project = ProjectPoint(Point=clean, Direction=Z, Geometry=brep)  # -> Point, Index
rasante_altura = ClusterOutput(brep)
del = DelaunayMesh(Points=project.Point, Plane=PlaneXY(0, 0, 0))
Z_2 = UnitZ(Factor=multiplication_2)
extr = Extrude(Base=crv, Direction=Z_2)
mesh = Mesh(extr)
msplit = MeshSplit(Mesh=del, Splitters=mesh)
item = ListItem(List=msplit, Index=0, Wrap=True)
msh2psrf = MeshToPolysurface(Mesh=item, Triangles=False, FaceMerge=False)
edges = BrepEdges(Brep=msh2psrf)  # -> Naked, Interior, NonManifold
crv_2 = Curve(edges.Naked)
project_2 = Project(Geometry=crv_2, Plane=PlaneXY(0, 0, 0))  # -> Geometry, Transform
join_2 = JoinCurves(Curves=project_2.Geometry, Preserve=False)
join_3 = JoinCurves(Curves=crv_2, Preserve=False)
loft = Loft(
    Curves=[join_3, join_2],
    Options={Adjust=False, Closed=False, LoftEnds=0, LoftSimp=0, LoftType=0, Rebuild=10, Refit=0.01})
join_4 = BrepJoin(Breps=[msh2psrf, loft])  # -> flatten(Breps), Closed
región_útil = BrepJoin(Breps=join_4.Breps)  # -> Breps, Closed
Z_3 = UnitZ(Factor=1)
area = Area(Geometry=crv)  # -> Area, Centroid
num = Number(2.8)
contour = Contour(Shape=región_útil.Breps, Point=area.Centroid, Direction=Z_3, Distance=num)
isocurvas_región_útil = Project(Geometry=contour, Plane=PlaneXY(0, 0, 0))  # -> simplify(Geometry), Transform
región_útil_2 = ClusterOutput(región_útil.Breps)
isocurvas = ClusterOutput(isocurvas_región_útil.Geometry)

# ==== cluster DefinirTipoligías
x_torre = ClusterInput()
y_torre = ClusterInput()
n_torres = ClusterInput()
x_barra = ClusterInput()
n_barras = ClusterInput()
y_barra = ClusterInput()
X = UnitX(Factor=expr("x+5", x_torre))
rectangle = Rectangle(Plane=PlaneXY(0, 0, 0), XSize=x_torre, YSize=y_torre, Radius=0)  # -> Rectangle, Length
Y = UnitY(Factor=-25)
rectangle_2 = Rectangle(Plane=PlaneXY(0, 0, 0), XSize=x_barra, YSize=y_barra, Radius=0)  # -> Rectangle, Length
move = Move(Geometry=rectangle.Rectangle, Motion=Y)  # -> Geometry, Transform
X_2 = UnitX(Factor=expr("x+5", x_barra))
area = Area(Geometry=rectangle_2.Rectangle)  # -> Area, Centroid
area_2 = Area(Geometry=rectangle.Rectangle)  # -> Area, Centroid
torres = LinearArray(Geometry=move.Geometry, Direction=X, Count=n_torres)  # -> Geometry, Transform
área_barra = ClusterOutput(area.Area)
área_torre = ClusterOutput(area_2.Area)
barras = LinearArray(Geometry=rectangle_2.Rectangle, Direction=X_2, Count=n_barras)  # -> Geometry, Transform
crv = Curve([torres.Geometry, barras.Geometry])
crv_2 = ClusterOutput(crv)

# ==== cluster DensidadÁreaOcupada
región_útil_torres = ClusterInput()
región_útil_barras = ClusterInput()
base_barras = ClusterInput()
brep = Brep(región_útil_torres)
base_torres = ClusterInput()
brep_2 = Brep(región_útil_barras)
cluster = Cluster(tipología_curvas=base_barras, región_útil=brep_2)  # -> bloques, flatten(array)
cluster_2 = Cluster(tipología_curvas=base_torres, región_útil=brep)  # -> bloques, flatten(array)
area = Area(Geometry=cluster.array)  # -> Area, Centroid
area_2 = Area(Geometry=cluster_2.array)  # -> Area, Centroid
torres = ClusterOutput(cluster_2.bloques)
barras = ClusterOutput(cluster.bloques)
ma = MassAddition(Input=area.Area)  # -> Result, PartialResults
lng = ListLength(List=area.Area)
ma_2 = MassAddition(Input=area_2.Area)  # -> Result, PartialResults
lng_2 = ListLength(List=area_2.Area)
number = Number(0.85)
barra = Multiplication(A=ma.Result, B=number)
torre = Multiplication(A=ma_2.Result, B=number)
_50 = Number(50)
addition = Addition(A=ma_2.Result, B=ma.Result)
torre_2 = Division(A=torre, B=_50)
barra_2 = Division(A=barra, B=_50)
addition_2 = Addition(A=torre_2, B=barra_2)
área_construida = ClusterOutput(addition)
densidad_total = ClusterOutput(addition_2)

# ==== cluster FiltroBloques
área_útil = ClusterInput()
open_nest = ClusterInput()
clean = CleanTree(RemoveNulls=True, RemoveInvalid=True, RemoveEmpty=False, Tree=open_nest)
colom = CollisionOneMany(Collider=clean, Obstacles=área_útil)  # -> Collision, Index
cset = CreateSet(List=colom.Collision)  # -> Set, Map
cset_2 = CreateSet(List=cset.Map)  # -> Set, Map
mindex = MemberIndex(Set=cset.Map, Member=cset_2.Set)  # -> simplify(Index), Count
num = Number(cset.Set)
item = ListItem(List=num, Index=0, Wrap=True)
branch = TreeBranch(Tree=mindex.Index, Path=item, MaintainPaths=True)
cull_i = CullIndex(List=clean, Indices=branch, Wrap=True)
curvas_dentro_del_lote = ClusterOutput(cull_i)

# ==== cluster DefinirResultados
srf_dentro_del_lote = ClusterInput()
area = Area(Geometry=srf_dentro_del_lote)  # -> Area, Centroid
round = Round(Number=area.Area)  # -> Nearest, Floor, Ceiling
área_barra = ClusterInput()
ma = MassAddition(Input=round.Nearest)  # -> Result, PartialResults
equals = Equality(FirstNumber=round.Nearest, SecondNumber=área_barra)  # -> Equality, Inequality
dispatch = Dispatch(List=round.Nearest, DispatchPattern=equals.Equality)  # -> ListA, ListB
listdexs = ListIndices(List=equals.Equality)
barras = ListLength(List=dispatch.ListA)
torres = ListLength(List=dispatch.ListB)
split = SplitList(List=listdexs, Index=torres)  # -> ListA, ListB
addition = Addition(A=barras, B=torres)
n_bloques = ClusterOutput(addition)
n_barras = ClusterOutput(barras)
bases_torres = ClusterOutput(split.ListB)
área_ocupada = ClusterOutput(ma.Result)
n_torres = ClusterOutput(torres)
bases_barras = ClusterOutput(split.ListA)

# ==== cluster Bruta
C = ClusterInput()
S = ClusterInput()
srfsplit = SurfaceSplit(Surface=S, Curves=C)
area = Area(Geometry=srfsplit)  # -> Area, Centroid
hilonums = HighestLowestNumbers(Numbers=area.Area)  # -> Highest, Lowest
fsim = FindSimilarMember(Data=hilonums.Highest, Set=area.Area)  # -> Hit, Index
cull_i = CullIndex(List=srfsplit, Indices=fsim.Index, Wrap=True)
srf = Surface(cull_i)
srf_2 = ClusterOutput(srf)

# ==== cluster AlturaMáxRasante
crv = ClusterInput()
num = ClusterInput()
crv_2 = Curve(crv)
num_2 = Number(num)
disc = Discontinuity(Curve=crv_2, Level=1)  # -> Points, Parameters
neg = Negative(Value=num_2)
shift = ShiftList(List=disc.Points, Shift=-1, Wrap=True)
area = Area(Geometry=crv_2)  # -> Area, Centroid
shift_2 = ShiftList(List=disc.Points, Shift=1, Wrap=True)
vec2pt = Vector2Pt(PointA=disc.Points, PointB=shift, Unitize=False)  # -> Vector, Length
number_slider = Slider(4, range=0..10)
number_slider_2 = Slider(6, range=0..10)
number_slider_3 = Slider(28, range=5..100)
sin = Sine(Value=degrees(num_2))
unit = UnitVector(Vector=vec2pt.Vector)
A = ClusterInput()
vec2pt_2 = Vector2Pt(PointA=disc.Points, PointB=shift_2, Unitize=False)  # -> Vector, Length
vec2pt_3 = Vector2Pt(PointA=area.Centroid, PointB=disc.Points, Unitize=False)  # -> Vector, Length
division = Division(A=A, B=sin)
unit_2 = UnitVector(Vector=vec2pt_2.Vector)
addition = Addition(A=unit_2, B=unit)
dprod = DotProduct(VectorA=vec2pt_3.Vector, VectorB=addition, Unitize=True)
round = Round(Number=dprod)  # -> Nearest, Floor, Ceiling
neg_2 = Negative(Value=round.Nearest)
multiplication = Multiplication(A=addition, B=neg_2)
line = LineSDL(Start=disc.Points, Direction=multiplication, Length=division)
rotate = Rotate(Geometry=line, Angle=degrees(90), Plane=disc.Points)  # -> Geometry, Transform
rot3d = Rotate3D(Geometry=line, Angle=degrees(neg), Center=disc.Points, Axis=rotate.Geometry)  # -> Geometry, Transform
curvas_loft = Curve(rot3d.Geometry)
loft = Loft(Curves=rot3d.Geometry, Options={Adjust=False, Closed=True, LoftEnds=0, LoftSimp=0, LoftType=3, Rebuild=10, Refit=0.01})
explode = ExplodeObject(Object=loft, Recursive=False)
loft_2 = Brep(explode)
curvas_loft_2 = ClusterOutput(curvas_loft)
loft_3 = ClusterOutput(loft_2)
curvepoint = PointOnCurve(rot3d.Geometry, parameter=1)
explode_2 = ExplodeObject(Object=loft, Recursive=False)
curvepoint_2 = PointOnCurve(rot3d.Geometry, parameter=1)
area_2 = Area(Geometry=explode)  # -> Area, Centroid
pline = PolyLine(Vertices=curvepoint, Closed=True)
number_slider_4 = Slider(1, range=0..10)
boundary = BoundarySurfaces(Edges=pline)
srf = Surface([boundary, explode_2])

# ---- group: Point List
points = PointList(Points=area_2.Centroid, Size=number_slider_4)
points_2 = PointList(Points=curvepoint_2, Size=number_slider_4)

# ----
srf_2 = ClusterOutput(srf)

# ---- group: Vector Display
vdis = VectorDisplay(Anchor=disc.Points, Vector=unit)
vdis_2 = VectorDisplay(Anchor=disc.Points, Vector=unit_2)
vdis_3 = VectorDisplay(Anchor=disc.Points, Vector=multiplication)
vdis_4 = VectorDisplay(Anchor=area.Centroid, Vector=vec2pt_3.Vector)

# ==== cluster Cluster
tipología_curvas = ClusterInput()
región_útil = ClusterInput()
disc = Discontinuity(Curve=tipología_curvas, Level=1)  # -> Points, Parameters
Z = UnitZ(Factor=1)
lng = ListLength(List=tipología_curvas)
project = ProjectPoint(Point=disc.Points, Direction=Z, Geometry=región_útil)  # -> Point, Index
pdecon = Deconstruct(Point=project.Point)  # -> XComponent, YComponent, ZComponent
round = Round(Number=pdecon.ZComponent)  # -> Nearest, Floor, Ceiling
item = ListItem(List=round.Nearest, Index=0, Wrap=True)
addition = Addition(A=item, B=0.001)
replace = ReplaceItems(List=round.Nearest, Item=addition, Indices=0, Wrap=False)
ordenar_menor_a_mayor = SortList(Keys=replace)  # -> Keys, ValuesA
extraer_el_menor_de_cada_lista = ListItem(List=ordenar_menor_a_mayor.Keys, Index=0, Wrap=True)
ver_dónde_está_el_menor = Equality(FirstNumber=replace, SecondNumber=extraer_el_menor_de_cada_lista)  # -> Equality, Inequality
cset = CreateSet(List=ver_dónde_está_el_menor.Equality)  # -> Set, Map
cset_2 = CreateSet(List=cset.Map)  # -> Set, Map
separar_indices_menor_valor_vs_resto = MemberIndex(Set=cset.Map, Member=cset_2.Set)  # -> simplify(Index), Count
_2 = Number(2)
me_quedo_con_listas_con_length_1 = PruneTree(Tree=separar_indices_menor_valor_vs_resto.Index, Minimum=0, Maximum=_2)  # -> flatten(Tree)
graft = GraftTree(Tree=me_quedo_con_listas_con_length_1, IncludeEmptyLists=True, IncludeNullItems=True)
punto_más_bajo = ListItem(List=project.Point, Index=graft, Wrap=True)  # -> flatten(Item)
cullpt = CullDuplicates(Points=punto_más_bajo, Tolerance=0.1, CullMode=3)  # -> Points, Indices, Valence
pdecon_2 = Deconstruct(Point=cullpt.Points)  # -> XComponent, YComponent, flatten(ZComponent)
simplify = SimplifyTree(Tree=cullpt.Points, Front=False)
clean = CleanTree(RemoveNulls=True, RemoveInvalid=True, RemoveEmpty=False, Tree=pdecon_2.ZComponent)
filtrar_los_puntos_más_bajos = SortList(Keys=clean)  # -> Keys, ValuesA
split = SplitList(List=filtrar_los_puntos_más_bajos.Keys, Index=lng)  # -> ListA, ListB
fsim = FindSimilarMember(Data=split.ListB, Set=pdecon_2.ZComponent)  # -> Hit, Index
eliminar_puntos_que_sobran = CullIndex(List=simplify, Indices=fsim.Index, Wrap=True)
pdecon_3 = Deconstruct(Point=eliminar_puntos_que_sobran)  # -> XComponent, YComponent, ZComponent
division = Division(A=pdecon_3.ZComponent, B=2.8)
round_2 = Round(Number=division)  # -> Nearest, Floor, Ceiling
number = Number(2.8)
Z_2 = UnitZ(Factor=number)
srf = Surface(tipología_curvas)
Z_3 = UnitZ(Factor=number)
arrlinear = LinearArray(Geometry=srf, Direction=Z_2, Count=round_2.Floor)  # -> Geometry, Transform
extr = Extrude(Base=arrlinear.Geometry, Direction=Z_3)
sunion = SolidUnion(Breps=extr)  # -> simplify(Result)
array = ClusterOutput(arrlinear.Geometry)
bloques = ClusterOutput(sunion)
