# Grasshopper definition Hops Tests.gh (Grasshopper 1.0.8)
# plug-ins: Hops

num = Number(Slider(73, range=0..100))
knob = ControlKnob(Decimals=2, Limit=True, Maximum=10, Minimum=0, Range=1, Value=0)
hops = Hops(
    AAAAA=num,
    BCEE=num,
    CacheResultsInMemory=False,
    CacheSolveResults=False,
    RemoteDefinitionLocation="http://localhost:5000/add",
    RemoteSolveVersion=(0, 1, 0),
    ShowInput_Enabled=False,
    ShowInput_Path=False,
    SynchronousSolve=True)
panel = Panel(hops)
